# Grasshopper definition filming.gh (Grasshopper 1.0.7)
# plug-ins: Kangaroo2 Components, FologramForGrasshopper

# ---- group: Fologram
# #GSD6338
# Introduction to Computational Design
# Instructor: Jose Luis García del Castillo y López
# Harvard University Graduate School of Design
# Fologram_MotionTracker - Tablet Device Recorder
# This file contains a sample Grasshopper definition to record motion information from multiple phones and tablets and save it to a CSV file.
# This file uses the Fologram plug-in to read from the phone and tablet.
# https://fologram.com/
# Authors: Joonhaeng Lee, Jose Luis García del Castillo y Lopez.
# 
# This file is part of a class assignment for GSD6338: Introduction to Computational Design.
# More info on: https://www.gsd.harvard.edu/course/introduction-to-computational-design-fall-2020/
devices = ConnectedDevices(device_filter=3, hasSerializedData=True)
device = TrackDevice(Device=devices, hasSerializedData=True, update_mode=1)
state = TrackState(Device=devices, hasSerializedData=True, update_mode=1)

# ----
lng = ListLength(List=devices)
null = NullItem(Item=state)  # -> NullFlags, InvalidFlags, Description
pln = Plane(device)
int = Integer(null.NullFlags)

# ---- group: For each update of the device, generate a Unix timestamp
c_script = CSharpScript(data=pln)  # -> out, timestamp; inputs data: Plane
# ---------- c_script: C# usings ----------
using System.IO;
using System.Linq;
using System.Data;
using System.Drawing;
using System.Reflection;
using System.Windows.Forms;
using System.Xml;
using System.Xml.Linq;
using System.Runtime.InteropServices;

using Rhino.DocObjects;
using Rhino.Collections;
using GH_IO;
using GH_IO.Serialization;
# ---------- c_script: C# ----------
    // This file generates a new UNIX timestamp any time new data is fed to it.

    // The Unix Epoch timestamp is the number of seconds (or milliseconds) that have elapsed
    // since Jan 1st 1970, and it is a very common way of storing time in computers.
    // https://en.wikipedia.org/wiki/Unix_time

    // It doesn't matter which data this component is fed, the data input is only used to monitor
    // changes in data input and trigger the generation of a new stamp; this technique is
    // commonly referred to as using data as a "ticker".

    // Code from: https://stackoverflow.com/a/17632585
    // We use long type because the largest number a 32-bit signed integer can store is 2147483647:
    // https://en.wikipedia.org/wiki/2,147,483,647
    long unixTimestamp = (long) DateTime.UtcNow.Subtract(new DateTime(2019, 10, 1)).TotalMilliseconds;

    // Output
    timestamp = unixTimestamp;
# ---------- end c_script ----------
# Connection steps:
# 
# First connect filming device
# Then connect recording device
panel = Panel(c_script.timestamp)
c_script_2 = CSharpScript(timestamp=c_script.timestamp)  # -> out, humanReadable; inputs timestamp: String
# ---------- c_script_2: C# ----------
    // Grasshopper inputs cannot be set to longs; let's convert the string timestamp to long
    long ts = Convert.ToInt64(timestamp);

    // Let's convert it to seconds; notice how integer division here avoids decimal problems!
    ts /= 1000;

    // Code from: https://stackoverflow.com/a/250400
    // Create a timestamp for Epoch (Jan 1st 1970)
    System.DateTime dtDateTime = new DateTime(2019, 10, 1, 0, 0, 0, 0, System.DateTimeKind.Utc);

    // Add the seconds elapsed since, and convert to human time representation
    humanReadable = dtDateTime.AddSeconds(ts).ToLocalTime();
    Print(ts.ToString());
# ---------- end c_script_2 ----------
panel_2 = Panel(c_script_2.humanReadable)

# ---- group: Simple trick to change 1 to 0, 0 to 1
expression = Expression(x=int, Expression="abs(x-1)")

# ---- group: why using graft? it is for ambitious students who wish to use more than one device
graft = GraftTree(Tree=c_script.timestamp, IncludeEmptyLists=True, IncludeNullItems=True)
graft_2 = GraftTree(Tree=pln, IncludeEmptyLists=True, IncludeNullItems=True)

# ---- group: Your screen pressed : 1, not pressed: 0
int_2 = Integer(expression)

# ---- group: Number of Devices you are recording
int_3 = Integer(lng)

# ----
tree_branch = TreeBranch(Tree=graft_2, Path="{0;0;1}", MaintainPaths=True)
tree_branch_2 = TreeBranch(Tree=int_2, Path="{0;1}", MaintainPaths=True)
entwine = Entwine(Branch00=graft, Branch01=tree_branch, Branch02=tree_branch_2, Branch03=int_3, FlattenInputs=True)
panel_3 = Panel(int_2)

# ---- group: RECORD!
rec = DataRecorder(entwine, DataLimit=-10, RecordData=False)

# ----
tree_branch_3 = TreeBranch(Tree=graft, MaintainPaths=True)
bang = ExplodeTree(Data=rec)  # -> flatten(Branch0), flatten(Branch1), flatten(Branch2), Branch3
recorded_planes = Panel(bang.Branch2)
item = ListItem(List=bang.Branch3, Index=0, Wrap=True)
txt = Text(bang.Branch0)
number_of_recorded_devices = Panel(item)

# ---- group: CSV control parameters
panel_4 = Panel("Recording_001")
use_local_folder = BooleanToggle(True)
save = Button()

# ----
int_4 = Integer(number_of_recorded_devices)
recorded_planes_2 = Panel(bang.Branch1)
c_script_3 = CSharpScript(
    name=panel_4,
    useLocalFolder=use_local_folder,
    save=save,
    timeStamp=txt,
    plane=bang.Branch1,
    trackState=bang.Branch2,
    deviceCount=int_4)  # -> out; inputs name: String, useLocalFolder: Boolean, save: Boolean, timeStamp: list of String, plane: list of Plane, trackState: list of Int32, deviceCount: Int32
# ---------- c_script_3: C# ----------
    // This component only runs only "save" is ture
    // Reading, spliting, and writing data takes time. And you do not need to do this process multiple times.
    // So this following code are designed to only run once when you click the button "Save?"
    if (save == false) {
      return;
    }

    // Check the number of devices that you recorded.
    Print(deviceCount.ToString() + " device(s) found");

    // Creates empty list to store all data you are going to export to CSV.
    // The data we are going to export is TEXT, so the type of the list is string.
    List<string> dataRecordAll = new List<string>();

    // Make a string variable which will stores data of each time stamp
    string datarecord;

    // Check how many lines(frames) of data we are going to store.
    // Each iteration "Rec" component record n rows of data, when n is the number of devices you are working with.
    // timeStamp for example, there will be 2 identical time stamp in data if you use two recording devices.
    int num = timeStamp.Count / deviceCount;

    // Let's print how many data we got.
    Print(num.ToString() + " data entries");

    // in for loop, rows of timeStamp, plane, trackStates saved in datarecord as string.
    for (int i = 0; i < num;i++){

      datarecord = timeStamp[i * deviceCount] + ",";

      for (int j = 0; j < deviceCount ; j++){

        datarecord = datarecord
          + plane[i * deviceCount + j].Origin.X.ToString() + ","
          + plane[i * deviceCount + j].Origin.Y.ToString() + ","
          + plane[i * deviceCount + j].Origin.Z.ToString() + ","
          + plane[i * deviceCount + j].XAxis.X.ToString() + ","
          + plane[i * deviceCount + j].XAxis.Y.ToString() + ","
          + plane[i * deviceCount + j].XAxis.Z.ToString() + ","
          + plane[i * deviceCount + j].YAxis.X.ToString() + ","
          + plane[i * deviceCount + j].YAxis.Y.ToString() + ","
          + plane[i * deviceCount + j].YAxis.Z.ToString() + ","
          ;

        if ( j < deviceCount - 1){
          datarecord = datarecord + trackState[i * deviceCount + j] + ",";
        }
        else{
          datarecord = datarecord + trackState[i * deviceCount + j];
        }

      }

      // After reading a set of data, add this to the list we created at the begining.
      dataRecordAll.Add(datarecord);
    }

    int frames = dataRecordAll.Count;
    string csv = ShortHeaders(deviceCount);
    for(int i = 0; i < frames; i++){
      csv = csv + dataRecordAll[i] + "\n";
    }

    string targetFolder = "";
    if (useLocalFolder) {
      // https://www.grasshopper3d.com/forum/topics/get-location-of-current-grasshopper-file
      GH_Document gh_d = owner.OnPingDocument();
      if (gh_d.IsFilePathDefined)
      {
        // Figure out the path of this GH file.
        string ghFilePath = gh_d.FilePath;
        // Remove the filename from it
        targetFolder = Path.GetDirectoryName(ghFilePath);
      }
      else
      {
        Print("No local folder found, please save your file locally.");
      }
    }
      // Otherwise, use the Desktop folder
    else {
      // First, we need to figure out the path to your Desktop:
      targetFolder = Environment.GetFolderPath(Environment.SpecialFolder.Desktop);
    }

    // Add the name of the file to the destination folder
    string filepath = Path.Combine(targetFolder, name + ".csv");
    Print("Destination file: " + filepath);

    File.WriteAllText(filepath, csv);
    Print("File " + filepath + " has been saved!");
# ---------- c_script_3: C# additional code ----------
  static string ShortHeaders(int deviceCount) {
    string headers = "TIMESTAMP,";

    for (int i = 0; i < deviceCount ; i++){
      headers = headers + "ORIGIN_X,ORIGIN_Y,ORIGIN_Z,XAXIS_X,XAXIS_Y,XAXIS_Z,YAXIS_X,YAXIS_Y,YAXIS_Z,";

      if (i < deviceCount - 1){
        headers = headers + "STATE,";
      }
      else{
        headers = headers + "STATE";
      }
    }
    headers = headers + "\n";


    return headers;
  }
# ---------- end c_script_3 ----------
output = Panel(c_script_3)

# ----
# curves
c_script_4 = CSharpScript(planes=bang.Branch1, pressed=bang.Branch2)  # -> out, pressedP, origins; inputs planes: list of Plane, pressed: list of Boolean
# ---------- c_script_4: C# ----------
    List<Point3d> ori = new List<Point3d>();
    for (int i = 0; i < planes.Count; i++)
    {
      Point3d oriTemp = planes[i].Origin;
      ori.Add(oriTemp);
    }
    origins = ori;

    //extract points from tween curves
    List <Plane> pressedPlanes = new List <Plane> ();
    for (int i = 0; i < pressed.Count; i++)
    {

      if (pressed[i] == true)
      {
        pressedPlanes.Add(planes[i]);
      }
    }



    pressedP = pressedPlanes;

    // find point with cloest point
    /*  List<Point3d> cloestPlanesOnTween = new List<Point3d>();
    for (int i = 0;i < tweenCurves.Length ;i++)
    {
    for (int j = 0; j < pressedPlanes.Count; j++)
    {
    cloestPlanesOnTween.Add = tweenCurves[i].ClosestPoint(pressedPlanes[j].Origin);
    }
    }

    */
    //do something with that ie something explode in 3d


    /* example code for attractor point
    double minDistance = double.MaxValue;
    for (int i = 0; i < points.Count; i++)
    // you could also use a foreach loop if you don't care about indices)
    {
    double localDistance = locus.DistanceTo(points[i]);
    minDistance = Math.Min(minDistance, localDistance);
    }
    return minDistance;
    */
# ---------- end c_script_4 ----------
pt = Point(c_script_4.origins)
pt_2 = Point(c_script_4.pressedP)
number_slider = Slider(255, range=0..1000)
c_script_5 = CSharpScript(
    obstacle=pt_2,
    ptOnCrv=pt,
    numCrv=Slider(20, range=0..100),
    waveWidth=Slider(30, range=0..100),
    waveHeight=Slider(100, range=0..100))  # -> out, IntCrv, MinD, DPts, DupCrvOffset, MinDIndex, Para, NDPts, Curves; inputs obstacle: list of Point3d, ptOnCrv: list of Point3d, numCrv: Int32, waveWidth: Int32, waveHeight: Int32
# ---------- c_script_5: C# ----------
    Curve track = Curve.CreateInterpolatedCurve(ptOnCrv, 3);

    int seg = ptOnCrv.Count + 100;
    int obs_count = obstacle.Count;
    Point3d [] dividedPt;
    double [] para;
    para = track.DivideByCount(seg, true, out dividedPt);

    //Creat Multiple Lines (duplicates of rebuilt original line)
    List<Curve> tracknew = new List<Curve>();
    int off = numCrv;
    for (int i = 0; i < off; i++)
    {
      Curve track_n = track.DuplicateCurve();
      tracknew.Add(track_n);
    }

    //Find nearest control Point to each obstacle point

    // Create empty list
    List<Point3d> nearest_dividedPoint = new List<Point3d>();
    List<double> min_dis = new List<double>();
    List<int> min_dis_index = new List<int>();
    for (int i = 0; i < obs_count; i++)
    {
      min_dis.Add(3000);
      Point3d pt = new Point3d();
      nearest_dividedPoint.Add(pt);
      min_dis_index.Add(0);
    }

    // Add point to list
    for (int i = 0; i < obs_count; i++)
    {
      for (int j = 0; j < seg; j++)
      {
        double distance = dis(obstacle[i], dividedPt[j]);
        if (distance < min_dis[i])
        {
          min_dis[i] = distance;
          nearest_dividedPoint[i] = dividedPt[j];
          min_dis_index[i] = j;
        }
      }
    }

    //Create waves
    int wave_width = waveWidth;
    int wave_height = waveHeight;

    //offset track[i]
    List<Curve> trackoffset = new List<Curve>();
    for (int i = 0; i < off; i++)
    {
      double offset = i * 0.5;
      Vector3d vec = new Vector3d(0, 0, offset);
      tracknew[i].Transform(Rhino.Geometry.Transform.Translation(vec));
      trackoffset.Add(tracknew[i]);
    }

    for (int i = 0; i < off; i++)  // curve
    {

      //divide track[i]
      Point3d [] dividedPt_n;
      tracknew[i].DivideByCount(seg, true, out dividedPt_n);
      for (int j = 0;j < obs_count;j++)//  wave
      {
        for(int k = wave_width; k > 0;k--)//point
        {
          int a = min_dis_index[j];
          int x = Math.Abs(a - (wave_width - k) - i);//cannot be negative_width
          double split = 0.8;
          double up = wave_height * k * 0.1 * ( split * off - i) * Math.Pow(0.8, (wave_width * 1.5 - k));

          //transfer control point
          Vector3d tangent = tracknew[i].TangentAt(para[a]);
          Vector3d vec = new Vector3d(0, 0, up);
          double direction = Math.Pow(-1, j);
          vec.Rotate(i * 0.05 * Math.PI * 2 * direction, tangent);// add time coef to angle(redians)
          dividedPt_n[x].Transform(Rhino.Geometry.Transform.Translation(vec));
        }
      }
      //Redraw track[i]
      tracknew[i] = Curve.CreateControlPointCurve(dividedPt_n, 3);
    }

    IntCrv = track;
    DupCrvOffset = trackoffset;
    Para = para;
    DPts = dividedPt;
    MinD = min_dis;
    NDPts = nearest_dividedPoint;
    MinDIndex = min_dis_index;
    Curves = tracknew;
# ---------- c_script_5: C# additional code ----------
  static double dis(Point3d a, ControlPoint b)
  {
    Vector3d vec = new Vector3d (a.X - b.X, a.Y - b.Y, a.Z - b.Z);
    double dis = vec.Length;
    return dis;
  }
# ---------- end c_script_5 ----------
hsl = ColourHSL(Alpha=number_slider, Hue=number_slider, Saturation=number_slider, Luminance=number_slider)
curve = Curve(c_script_5.IntCrv)
point = Point(c_script_5.DPts)
curve_2 = Curve(c_script_5.DupCrvOffset)
point_2 = Point(c_script_5.NDPts)
sync_object = SyncObject(
    GM=c_script_5.Curves,
    AlwaysIncludeTextureCoordinates=False,
    Clickable=False,
    DefaultCurveThicknessMillimeters=2.5,
    DefaultGlossPercent=0,
    DefaultMaterialColor=RGB(150, 60, 230),
    DefaultSpecularPercent=0,
    Grabbable=False,
    Interactive=False,
    Occlusion=False,
    Outline=False,
    hasSerializedData=True)

item_2 = ListItem(List=pt, Index="-1", Wrap=True)
# Before Starting
# 
# enable timer
# press button
button = Button()
timer = Timer(TimerInterval=20, Target=c_script_6)  # disabled
# geometry cloud
panel_5 = Panel(item_2)
c_script_6 = CSharpScript(reset=button)  # -> out, framerate; inputs reset: Boolean
# ---------- c_script_6: C# ----------
    num = reset ? 0 : num + 1;
    framerate = num;
    Print(num.ToString());
# ---------- c_script_6: C# additional code ----------
  private int num = 0;
# ---------- end c_script_6 ----------
pl = ConstructPlane(Origin=item_2, XAxis=Vector(1, 0, 0), YAxis=Vector(0, 1, 0))
box = CenterBox(Base=pl, X=Slider(400, range=0..1000), Y=Slider(400, range=0..1000), Z=Slider(400, range=0..1000))
panel_6 = Panel(c_script_6.out)
sin = Sine(Value=c_script_6.framerate)
pop3d = Populate3D(Region=box, Count=Slider(241, range=0..1000), Seed=1)
addition = Addition(A=sin, B="1")
cohmag = Slider(0.23, range=0..1)
alnmag = Slider(0.45, range=0..1)
cohfov = Slider(8.17, range=0..100)
alnfov = Slider(15.19, range=0..100)
division = Division(A=addition, B="2")
multiplication = Multiplication(A=division, B="10")
panel_7 = Panel(multiplication)
c_script_7 = CSharpScript(
    reset=Button(),
    startPts=pop3d,
    originBound=box,
    maxSped=Slider(23.4, range=0..100),
    sepMag=Slider(1, range=0..1),
    sepFOV=Slider(100, range=0..100),
    cohMag=cohmag,
    cohFOV=cohfov,
    alnMag=alnmag,
    alnFOV=alnfov,
    attMag=multiplication)  # -> out, A, B, C; inputs reset: Boolean, startPts: list of Point3d, originBound: Box, maxSped: Double, sepMag: Double, sepFOV: Double, cohMag: Double, cohFOV: Double, alnMag: Double, alnFOV: Double, attMag: Double
# ---------- c_script_7: C# ----------
    //update agent variable live
    maxSpeed = maxSped;

    separationMag = sepMag;
    separationFOV = sepFOV;

    cohesionMag = cohMag;
    cohesionFOV = cohFOV;

    alignmentMag = alnMag;
    alignmentFOV = alnFOV;

    attractMag = attMag;

    bound = originBound;

    //Empty point list and speed list
    ptList = new List<Point3d>();
    speedList = new List<Vector3d>();

    // Reset the agent simulation
    if(reset){
      //empty the agent list
      agentList = new List<Agent>();
      simulationCount = 0;

      //declare the agents and add to the agent list
      for(int i = 0; i < startPts.Count; i++){
        Agent agent01 = new Agent(startPts[i]);
        agentList.Add(agent01);
      }
    }

      //Run the agent simulation
    else{
      //setup boundary variable
      boxPt = bound.GetCorners()[0];
      xBound = bound.X.Length + boxPt.X;
      yBound = bound.Y.Length + boxPt.Y;
      zBound = bound.Z.Length + boxPt.Z;
      //Print("corner: " + bound.GetCorners()[0]);
      Print("center: " + bound.Center);
      Print("xbox: " + bound.X.Length);
      Print("ybox: " + bound.Y.Length);
      Print("zbox: " + bound.Z.Length);
      //Print("xBound: " + xBound);
      //Print("yBound: " + yBound);
      //Print("zBound: " + zBound);

      //for(int i = 0; i < agentList.Count; i++){
      System.Threading.Tasks.Parallel.For(0, agentList.Count, i => {
        {
          //Run agents
          Agent agent01 = agentList[i];
          agent01.run();

          lock(agentList){
            //Update the location list and speed list
            ptList.Add(agent01.loc);
            speedList.Add(agent01.speed);
          }
        }
        });
      //Add one value to the simulation count
      simulationCount++;
    }

    A = ptList;
    B = speedList;
    C = simulationCount;
# ---------- c_script_7: C# additional code ----------
  //Global Variable List
  static List<Agent> agentList = new List<Agent>();
  static List<Point3d> ptList = new List<Point3d>();
  static List<Vector3d> speedList = new List<Vector3d>();

  static int simulationCount;

  static double separationMag;
  static double separationFOV;

  static double cohesionMag;
  static double cohesionFOV;

  static double alignmentMag;
  static double alignmentFOV;

  static double attractMag;
  
  static double maxSpeed;

  static Box bound;

  //boundary variables
  static double xBound;
  static double yBound;
  static double zBound;
  static Point3d boxPt;

  //Agent
  public class Agent{
    //Class variables
    public Point3d loc = new Point3d();
    public Vector3d speed = new Vector3d();

    Vector3d accel = new Vector3d();
    //double maxSpeed = 1.00;

    //Class constructor
    public Agent(Point3d _loc){
      loc = _loc;
    }

    public void run(){
      //boundaryCross();
      move();
      separation();
      cohesion();
      alignment();
      attract();
      //boundaryCross();
    }

    //move each agent based on a speed vector
    void move(){
      //speed = new Vector3d(0, 0, 0);
      speed += accel;
      if(speed.Length > maxSpeed){
        speed.Unitize();
        speed *= maxSpeed;
      }
      loc += speed;

      accel = new Vector3d(0, 0, 0);

    }

    void attract(){
      Vector3d dir = new Vector3d();
      Vector3d v1 = bound.Center - loc;
      v1.Unitize();
      dir += v1;
      dir *= attractMag;

      accel += dir;

    }

    //Boundary Cross
    void boundaryCross(){
      if (loc.X < boxPt.X){
        //loc.X = xBound;
        loc.X = bound.Center.X;
      }else if (loc.X > xBound){
        //loc.X = boxPt.X;
        loc.X = bound.Center.X;
      }

      if (loc.Y < boxPt.Y){
        //loc.Y = yBound;
        loc.Y = bound.Center.Y;
      }else if (loc.Y > yBound){
        //loc.Y = boxPt.Y;
        loc.Y = bound.Center.Y;
      }

      if (loc.Z < boxPt.Z){
        //loc.Z = zBound;
        loc.Z = bound.Center.Z;
      }else if (loc.Z > zBound){
        //loc.Z = boxPt.Z;
        loc.Z = bound.Center.Z;
      }
    }


    //Separation Behaviour functions
    void separation(){
      //Declare an empty direction variable and a counter
      Vector3d dir = new Vector3d();
      int count = 0;

      for(int i = 0; i < agentList.Count; i++){
        //find the distance from current agent to all other agents
        Agent otherAgent = agentList[i];
        double dist = loc.DistanceTo(otherAgent.loc);

        //find nearby agents within the FOV
        if(dist > 0 && dist < separationFOV){
          //create a vector that moves away from other agents
          Vector3d v1 = loc - otherAgent.loc;


          //scale the vector's magnitude so when its closer it becomes more powerful
          v1.Unitize();
          v1 *= 1 / dist;

          //add the vector to the separation direction & specify that 1 agent is in the FOV with count
          dir += v1;
          count++;
        }
      }

      //if any agents are in FOV, add them to the acce
      if (count > 0){
        //divide the direction vector by count for average
        dir /= count;

        //scale vector
        dir *= 100;
        dir *= separationMag;

        //add to the acc
        accel += dir;
      }
    }


    //Cohesion Behavior function
    void cohesion(){
      Vector3d dir = new Vector3d();
      int count = 0;

      for (int i = 0; i < agentList.Count; i++){
        //find the distance from current agent to all other agents
        Agent otherAgent = agentList[i];
        double dist = loc.DistanceTo(otherAgent.loc);
        //find nearby agents within the FOV
        if(dist > 0 && dist < cohesionFOV){
          //find all other agent locs & add to dir
          dir += (Vector3d) otherAgent.loc;
          count++;
        }
      }

      if(count > 0){
        //find the average loc of other agents in FOV
        dir /= count;

        //move towards the average
        dir -= (Vector3d) loc;

        //scale & add to acc
        dir *= cohesionMag;
        accel += dir;
      }

    }

    //Alignment Behaviour function
    void alignment(){
      Vector3d dir = new Vector3d();
      int count = 0;

      for (int i = 0; i < agentList.Count; i++){
        //find the distance from current agent to all other agents
        Agent otherAgent = agentList[i];
        double dist = loc.DistanceTo(otherAgent.loc);
        //find nearby agents within the FOV
        if(dist > 0 && dist < alignmentFOV){
          //find speed vector of other agents
          dir += otherAgent.speed;
          count++;
        }
      }
      if(count > 0){
        //find the average speed of neighbors
        dir /= count;

        //scale & add to acc
        dir *= alignmentMag;
        accel += dir;
      }
    }




  }
# ---------- end c_script_7 ----------
ln = Line(StartPoint=c_script_7.A, EndPoint=c_script_7.B)
# Before Starting
# 
# enable timer
# press button
timer_2 = Timer(TimerInterval=20, Target=c_script_7)  # disabled
panel_8 = Panel(c_script_7.C)
panel_9 = Panel(c_script_7.out)
pgroups = PointGroups(Points=c_script_7.A, Distance=Slider(20, range=0..100))  # -> Groups, Indices
number_slider_2 = Slider(4.9, range=0..10)
inter = InterconnectPoints(Pts=pgroups.Groups)  # disabled
cir = Circle(Plane=c_script_7.A, Radius=number_slider_2)
rgb = ColourRGB(Alpha=255, Red=Slider(255, range=0..255), Green=Slider(210.2, range=0..255), Blue=Slider(98.2, range=0..255))
preview = CustomPreview(Geometry=inter, Material=rgb)
sync_object_2 = SyncObject(
    GM=inter,
    AlwaysIncludeTextureCoordinates=False,
    Clickable=False,
    DefaultCurveThicknessMillimeters=2.5,
    DefaultGlossPercent=0,
    DefaultMaterialColor=RGB(255, 230, 87),
    DefaultSpecularPercent=0,
    Grabbable=False,
    Interactive=False,
    Occlusion=False,
    Outline=False,
    hasSerializedData=True)
sync = SyncObject(
    GM=cir,
    AlwaysIncludeTextureCoordinates=False,
    Clickable=False,
    DefaultCurveThicknessMillimeters=2.5,
    DefaultGlossPercent=0,
    DefaultMaterialColor=RGB(255, 225, 100),
    DefaultSpecularPercent=0,
    Grabbable=False,
    Interactive=False,
    Occlusion=False,
    Outline=False,
    hasSerializedData=True)
cloud = CloudDisplay(Points=c_script_7.A, Colours=rgb, Size=number_slider_2, SpriteType=0)
