# Grasshopper definition readcsvfile.gh (Grasshopper 1.0.7)
# plug-ins: Kangaroo2 Components, FologramForGrasshopper

# ---- group: Let's use GH to read the CSV file into a List of strings. Make sure you replace the incoming path with wherever your file lives.
# #GSD6338
# Introduction to Computational Design
# Instructor: Jose Luis García del Castillo y López
# Harvard University Graduate School of Design
# Fologram_MotionTracker - CSV Data Reader
# This file contains a sample Grasshopper definition to read recorded motion information from a CSV file and reconstruct it in different ways.
# This file uses the Fologram plug-in to read from the phone and tablet: https://fologram.com/
# Authors: Joonhaeng Lee, Jose Luis García del Castillo y Lopez.
# 
# This file is part of a class assignment for GSD6338: Introduction to Computational Design.
# More info on: https://www.gsd.harvard.edu/course/introduction-to-computational-design-fall-2020/
panel = Panel("E:\Grad School\OneDrive - Harvard University\SCI6338\assignment[0]\Recording_001.csv")
file = ReadFile(File=panel, PerLineParse=True)

# ----
panel_2 = Panel(file)

# ---- group: Also simple example of how to read the CSV file, this time outputting geometry elements / Double-click me to learn more!
c_script = CSharpScript(data=file)  # -> out, t0_planes, t0_pressed; inputs data: list of String
# ---------- c_script: C# usings ----------
using System.IO;
using System.Linq;
using System.Data;
using System.Drawing;
using System.Reflection;
using System.Windows.Forms;
using System.Xml;
using System.Xml.Linq;
using System.Runtime.InteropServices;

using Rhino.DocObjects;
using Rhino.Collections;
using GH_IO;
using GH_IO.Serialization;
# ---------- c_script: C# ----------
    // You have seen in the previous example how to read the CSV in an "atomic" way, element by element.
    // However, most likely, you will want to end up reconstructing that data back
    // into Points, Vectors and / or Planes. So why not doing it right away?
    // This example is very similar to the previous one, except that instead of outputting
    // the numerical values representing the origin Point for the first tracker,
    // we will output a List of actual Point3d objects!
    // (Remember, to read more about how to output doubles, booleans or longs,
    // check the previous example. We will ignore that part in this one.)
    // Read the whole file before modifying it!

    // Since we now want to output geometry, let's create an empty list of Point3d
    List<Point3d> t0_origin_point_values = new List<Point3d>();

    // We still will keep the pressed values as single booleans...
    List<bool> t0_pressed_values = new List<bool>();

    // You can now add more lists of Points, Vectors and/or probably Plane objects here!
    // (your code goes here... )
    List<Plane> t0_plane_objects = new List<Plane>();



    // Let's iterate over all the string in the incoming data list, one per line.
    // Notice how we start with 1, because we want to skip the header in the file.
    for (int i = 1; i < data.Count; i++) {
      // Let's retrieve a line will all the data
      string dataRow = data[i];

      // Because it is a Comma-Separated Values (CSV) list, we values are separated with commas.
      // If we split the string with commas, we can get an array of strings with the individual values!
      // https://docs.microsoft.com/en-us/dotnet/api/system.string.split?view=netframework-4.5
      string[] dataColumns = dataRow.Split(',');  // notice how we use single quotes to indicate a char input

      // Bringing in the booleans for `pressed`, just like we did in the previous component.
      int pressedNum = Convert.ToInt32(dataColumns[10]);
      bool pressed = pressedNum == 1;
      t0_pressed_values.Add(pressed);

      // We learnt how to read doubles, longs, bools, etc. before, so let's focus on geometry.
      // If I want to output the origin Point of the tracker, I will probably have to:
      // - Read the string coordinates of the point,
      // - convert them to doubles,
      // - create a Point3d object with them,
      // - and store the point object in my Point3d List.
      // Let's do it!
      double oX = Convert.ToDouble(dataColumns[1]);  // shorthanding reading and converting to double
      double oY = Convert.ToDouble(dataColumns[2]);
      double oZ = Convert.ToDouble(dataColumns[3]);
      Point3d origin = new Point3d(oX, oY, oZ);
      t0_origin_point_values.Add(origin);

      // // The code above could be shorthanded in one line, but it becomes very hard to read... :(
      // t0_origin_point_values.Add(new Point3d(Convert.ToDouble(dataColumns[1]), Convert.ToDouble(dataColumns[2]), Convert.ToDouble(dataColumns[3])));

      // That's pretty much it! Try now importing and constructing the direction Vectors for the tracker.
      // Or... wouldn't it just be easier to directly construct a Plane object for the
      // tracker with the Origin and the two main Vectors...? :)
      // Write code here to create two vectors from the coordinates in the CSV,
      // and either store them on lists or use them along with the origin point
      // to create a Plane object and store that one on a list for outputting! (RECOMMENDED)

      // (your code goes here... )
      Vector3d vx = new Vector3d(
        Convert.ToDouble(dataColumns[4]),
        Convert.ToDouble(dataColumns[5]),
        Convert.ToDouble(dataColumns[6]));
      Vector3d vy = new Vector3d(
        Convert.ToDouble(dataColumns[7]),
        Convert.ToDouble(dataColumns[8]),
        Convert.ToDouble(dataColumns[9]));
      
      Plane pl = new Plane(origin, vx, vy);
      t0_plane_objects.Add(pl);
    }

    // Finally, remember to add more outputs to this GH component,
    // and output the Lists of geometry you just created.
    // t0_origin_points = t0_origin_point_values;

    // Output here your list of `pressed` booleans,
    // and your direction vectors or your orientation plane!
    // (your code goes here... )
    t0_planes = t0_plane_objects;
    t0_pressed = t0_pressed_values;
# ---------- end c_script ----------

# ---- group: A simple example of how to read the CSV file into its individual data points / Double-click me to learn more!
c_script_2 = CSharpScript(data=file)  # -> out, timestamps, t0_origin_x, t0_origin_y, t0_origin_z, t0_xaxis_x, t0_xaxis_y, t0_xaxis_z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; inputs data: list of String
# ---------- c_script_2: C# ----------
    // In this file, we will parse the CSV file with the recording, and get the values
    // of the objects as numerical lists.
    // Before starting to add your own code, we recommend you read through the whole
    // file, understand the code that is already given to you, and get a sense of
    // what you are asked to complete! :)

    // Let's create a bunch of lists to store all the indidivual components of the input data!
    // If instead of outputtting individual values, you would like to ouput
    // actual geometrical objects, look at the next example in this GH file.

    // Timestamps must be stored as longs (really big integers):
    List<long> timestamp_values = new List<long>();

    // Point/vector components can be stored as doubles:
    List<double> t0_origin_x_values = new List<double>();
    List<double> t0_origin_y_values = new List<double>();
    List<double> t0_origin_z_values = new List<double>();

    // We will help you with a sample for boolean values:
    List<bool> t0_pressed_values = new List<bool>();

    // This is an incomplete list of incoming data -->
    // --> you should complete these lists, adding more here to store
    //     the values of the axes or other additional devices, etc.
    // Craete lists of doubles for the coordinates of the two
    // direction vectors.
  
    // (your code goes here... )
    List<double> t0_xaxis_x_values = new List<double>();
    List<double> t0_xaxis_y_values = new List<double>();
    List<double> t0_xaxis_z_values = new List<double>();
    List<double> t0_yaxis_x_values = new List<double>();
    List<double> t0_yaxis_y_values = new List<double>();
    List<double> t0_yaxis_z_values = new List<double>();



    // Let's iterate over all the string in the incoming data list, one per line.
    // Notice how we start with 1, because we want to skip the header in the file.
    for (int i = 1; i < data.Count; i++) {
      // Let's retrieve a line will all the data
      string dataRow = data[i];

      // Because it is a Comma-Separated Values (CSV) list, we values are separated with commas.
      // If we split the string with commas, we can get an array of strings with the individual values!
      // https://docs.microsoft.com/en-us/dotnet/api/system.string.split?view=netframework-4.5
      string[] dataColumns = dataRow.Split(',');  // notice how we use single quotes to indicate a char input

      // Let's get the timestamp! We know it was on the first column, so must be the first element
      // in the array. However, remember we read it as a string, so we must convert it to long first!
      // Then, we just push it to the appropriate list.
      string tsString = dataColumns[0];
      long ts = Convert.ToInt64(tsString);  // `long` is actually a nickname for `int64`, an integer with 64 bits capacity!
      timestamp_values.Add(ts);

      // Same thing with the coordinates of the origin of the first tracker:
      // - Retrieve the string element from the row,
      // - convert it to a double, and
      // - add it to the corresponding list.
      // As opposed to the long before, where we split each step of the process in one line of code,
      // ee will be shorthanding these three operations in one line:
      t0_origin_x_values.Add(Convert.ToDouble(dataColumns[1]));
      t0_origin_y_values.Add(Convert.ToDouble(dataColumns[2]));
      t0_origin_z_values.Add(Convert.ToDouble(dataColumns[3]));

      // And the final example, importing a boolean value!
      // Interestingly, this value is stored as an integer (0 or 1),
      // which is a very common representation of boolean values on CSVs.
      // We will need to read the string, convert it to an integer, and then to a boolean!
      int pressedNum = Convert.ToInt32(dataColumns[10]);
      bool pressed = pressedNum == 1;
      t0_pressed_values.Add(pressed);


      // That's it! With these examples, you probably have a good start on how to parse
      // the rest of the data back into Grasshopper. Just create more empty lists above,
      // and in this for loop, take elements from each row, convert them to their appropiate
      // type, and then push them to their appropriate lists.
      // You can parse through the whole CSV file with this technique.
      // Parse the coordinates of the vectors here:

      // (your code goes here... )
      t0_xaxis_x_values.Add(Convert.ToDouble(dataColumns[4]));
      t0_xaxis_y_values.Add(Convert.ToDouble(dataColumns[5]));
      t0_xaxis_z_values.Add(Convert.ToDouble(dataColumns[6]));
      t0_yaxis_x_values.Add(Convert.ToDouble(dataColumns[7]));
      t0_yaxis_y_values.Add(Convert.ToDouble(dataColumns[8]));
      t0_yaxis_z_values.Add(Convert.ToDouble(dataColumns[9]));

    }

    // Finally, remember to add more outputs to this GH component,
    // and output the Lists of data you just parsed.
    timestamps = timestamp_values;
    t0_origin_x = t0_origin_x_values;
    t0_origin_y = t0_origin_y_values;
    t0_origin_z = t0_origin_z_values;
    t0_pressed = t0_pressed_values;

    // (your code goes here... )
    t0_xaxis_x = t0_xaxis_x_values;
    t0_xaxis_y = t0_xaxis_y_values;
    t0_xaxis_z = t0_xaxis_z_values;
    t0_yaxis_x = t0_yaxis_x_values;
    t0_yaxis_y = t0_yaxis_y_values;
    t0_yaxis_z = t0_yaxis_z_values;
# ---------- end c_script_2 ----------

# ---- group: To view these planes on the viewport, make sure you go to Display > Preview Plane Size > set the value to around 20 units
pln = Plane(c_script.t0_planes)

# ---- group: A simple example of how to read the CSV file into its individual data points
panel_3 = Panel(c_script_2.timestamps)
panel_4 = Panel(c_script_2.t0_origin_x)
panel_5 = Panel(c_script_2.t0_xaxis_x)
panel_6 = Panel(c_script_2.t0_yaxis_x)
panel_7 = Panel(c_script_2.t0_origin_y)
panel_8 = Panel(c_script_2.t0_xaxis_y)
panel_9 = Panel(c_script_2.t0_yaxis_y)
panel_10 = Panel(c_script_2.t0_origin_z)
panel_11 = Panel(c_script_2.t0_xaxis_z)
panel_12 = Panel(c_script_2.t0_yaxis_z)
panel_13 = Panel(c_script_2.t0_pressed)

# ---- group: Also simple example of how to read the CSV file, this time outputting geometry elements
panel_14 = Panel(c_script.t0_planes)
panel_15 = Panel(c_script.t0_pressed)

# ----
# curves
c_script_3 = CSharpScript(planes=c_script.t0_planes, pressed=c_script.t0_pressed)  # -> out, pressedP, origins; inputs planes: list of Plane, pressed: list of Boolean
# ---------- c_script_3: C# ----------
    List<Point3d> ori = new List<Point3d>();
    for (int i = 0; i < planes.Count; i++)
    {
      Point3d oriTemp = planes[i].Origin;
      ori.Add(oriTemp);
    }
    origins = ori;

    //extract points from tween curves
    List <Plane> pressedPlanes = new List <Plane> ();
    for (int i = 0; i < pressed.Count; i++)
    {

      if (pressed[i] == true)
      {
        pressedPlanes.Add(planes[i]);
      }
    }



    pressedP = pressedPlanes;

    // find point with cloest point
    /*  List<Point3d> cloestPlanesOnTween = new List<Point3d>();
    for (int i = 0;i < tweenCurves.Length ;i++)
    {
    for (int j = 0; j < pressedPlanes.Count; j++)
    {
    cloestPlanesOnTween.Add = tweenCurves[i].ClosestPoint(pressedPlanes[j].Origin);
    }
    }

    */
    //do something with that ie something explode in 3d


    /* example code for attractor point
    double minDistance = double.MaxValue;
    for (int i = 0; i < points.Count; i++)
    // you could also use a foreach loop if you don't care about indices)
    {
    double localDistance = locus.DistanceTo(points[i]);
    minDistance = Math.Min(minDistance, localDistance);
    }
    return minDistance;
    */
# ---------- end c_script_3 ----------
pt = Point(c_script_3.origins)
pt_2 = Point(c_script_3.pressedP)
number_slider = Slider(255, range=0..1000)
c_script_4 = CSharpScript(
    obstacle=pt_2,
    ptOnCrv=pt,
    numCrv=Slider(20, range=0..100),
    waveWidth=Slider(30, range=0..100),
    waveHeight=Slider(100, range=0..100))  # -> out, IntCrv, MinD, DPts, DupCrvOffset, MinDIndex, Para, NDPts, Curves; inputs obstacle: list of Point3d, ptOnCrv: list of Point3d, numCrv: Int32, waveWidth: Int32, waveHeight: Int32
# ---------- c_script_4: C# ----------
    Curve track = Curve.CreateInterpolatedCurve(ptOnCrv, 3);

    int seg = ptOnCrv.Count + 100;
    int obs_count = obstacle.Count;
    Point3d [] dividedPt;
    double [] para;
    para = track.DivideByCount(seg, true, out dividedPt);

    //Creat Multiple Lines (duplicates of rebuilt original line)
    List<Curve> tracknew = new List<Curve>();
    int off = numCrv;
    for (int i = 0; i < off; i++)
    {
      Curve track_n = track.DuplicateCurve();
      tracknew.Add(track_n);
    }

    //Find nearest control Point to each obstacle point

    // Create empty list
    List<Point3d> nearest_dividedPoint = new List<Point3d>();
    List<double> min_dis = new List<double>();
    List<int> min_dis_index = new List<int>();
    for (int i = 0; i < obs_count; i++)
    {
      min_dis.Add(3000);
      Point3d pt = new Point3d();
      nearest_dividedPoint.Add(pt);
      min_dis_index.Add(0);
    }

    // Add point to list
    for (int i = 0; i < obs_count; i++)
    {
      for (int j = 0; j < seg; j++)
      {
        double distance = dis(obstacle[i], dividedPt[j]);
        if (distance < min_dis[i])
        {
          min_dis[i] = distance;
          nearest_dividedPoint[i] = dividedPt[j];
          min_dis_index[i] = j;
        }
      }
    }

    //Create waves
    int wave_width = waveWidth;
    int wave_height = waveHeight;

    //offset track[i]
    List<Curve> trackoffset = new List<Curve>();
    for (int i = 0; i < off; i++)
    {
      double offset = i * 0.5;
      Vector3d vec = new Vector3d(0, 0, offset);
      tracknew[i].Transform(Rhino.Geometry.Transform.Translation(vec));
      trackoffset.Add(tracknew[i]);
    }

    for (int i = 0; i < off; i++)  // curve
    {

      //divide track[i]
      Point3d [] dividedPt_n;
      tracknew[i].DivideByCount(seg, true, out dividedPt_n);
      for (int j = 0;j < obs_count;j++)//  wave
      {
        for(int k = wave_width; k > 0;k--)//point
        {
          int a = min_dis_index[j];
          int x = Math.Abs(a - (wave_width - k) - i);//cannot be negative_width
          double split = 0.8;
          double up = wave_height * k * 0.1 * ( split * off - i) * Math.Pow(0.8, (wave_width * 1.5 - k));

          //transfer control point
          Vector3d tangent = tracknew[i].TangentAt(para[a]);
          Vector3d vec = new Vector3d(0, 0, up);
          double direction = Math.Pow(-1, j);
          vec.Rotate(i * 0.05 * Math.PI * 2 * direction, tangent);// add time coef to angle(redians)
          dividedPt_n[x].Transform(Rhino.Geometry.Transform.Translation(vec));
        }
      }
      //Redraw track[i]
      tracknew[i] = Curve.CreateControlPointCurve(dividedPt_n, 3);
    }

    IntCrv = track;
    DupCrvOffset = trackoffset;
    Para = para;
    DPts = dividedPt;
    MinD = min_dis;
    NDPts = nearest_dividedPoint;
    MinDIndex = min_dis_index;
    Curves = tracknew;
# ---------- c_script_4: C# additional code ----------
  static double dis(Point3d a, ControlPoint b)
  {
    Vector3d vec = new Vector3d (a.X - b.X, a.Y - b.Y, a.Z - b.Z);
    double dis = vec.Length;
    return dis;
  }
# ---------- end c_script_4 ----------
hsl = ColourHSL(Alpha=number_slider, Hue=number_slider, Saturation=number_slider, Luminance=number_slider)
curve = Curve(c_script_4.IntCrv)
point = Point(c_script_4.DPts)
curve_2 = Curve(c_script_4.DupCrvOffset)
point_2 = Point(c_script_4.NDPts)
sync_object = SyncObject(
    GM=c_script_4.Curves,
    AlwaysIncludeTextureCoordinates=False,
    Clickable=False,
    DefaultCurveThicknessMillimeters=2.5,
    DefaultGlossPercent=0,
    DefaultMaterialColor=RGB(150, 60, 230),
    DefaultSpecularPercent=0,
    Grabbable=False,
    Interactive=False,
    Occlusion=False,
    Outline=False,
    hasSerializedData=True)

item = ListItem(List=pt, Index="-1", Wrap=True)
# Before Starting
# 
# enable timer
# press button
button = Button()
timer = Timer(TimerInterval=1, Target=c_script_5)  # disabled
# geometry cloud
panel_16 = Panel(item)
c_script_5 = CSharpScript(reset=button)  # -> out, framerate; inputs reset: Boolean
# ---------- c_script_5: C# ----------
    num = reset ? 0 : num + 1;
    framerate = num;
    Print(num.ToString());
# ---------- c_script_5: C# additional code ----------
  private int num = 0;
# ---------- end c_script_5 ----------
pl = ConstructPlane(Origin=item, XAxis=Vector(1, 0, 0), YAxis=Vector(0, 1, 0))
box = CenterBox(Base=pl, X=Slider(400, range=0..1000), Y=Slider(400, range=0..1000), Z=Slider(400, range=0..1000))
panel_17 = Panel(c_script_5.out)
sin = Sine(Value=c_script_5.framerate)
pop3d = Populate3D(Region=box, Count=Slider(241, range=0..1000), Seed=1)
addition = Addition(A=sin, B="1")
cohmag = Slider(0.23, range=0..1)
alnmag = Slider(0.45, range=0..1)
cohfov = Slider(8.17, range=0..100)
alnfov = Slider(15.19, range=0..100)
division = Division(A=addition, B="2")
multiplication = Multiplication(A=division, B="10")
panel_18 = Panel(multiplication)
c_script_6 = CSharpScript(
    reset=Button(),
    startPts=pop3d,
    originBound=box,
    maxSped=Slider(23.4, range=0..100),
    sepMag=Slider(1, range=0..1),
    sepFOV=Slider(100, range=0..100),
    cohMag=cohmag,
    cohFOV=cohfov,
    alnMag=alnmag,
    alnFOV=alnfov,
    attMag=multiplication)  # -> out, A, B, C; inputs reset: Boolean, startPts: list of Point3d, originBound: Box, maxSped: Double, sepMag: Double, sepFOV: Double, cohMag: Double, cohFOV: Double, alnMag: Double, alnFOV: Double, attMag: Double
# ---------- c_script_6: C# ----------
    //update agent variable live
    maxSpeed = maxSped;

    separationMag = sepMag;
    separationFOV = sepFOV;

    cohesionMag = cohMag;
    cohesionFOV = cohFOV;

    alignmentMag = alnMag;
    alignmentFOV = alnFOV;

    attractMag = attMag;

    bound = originBound;

    //Empty point list and speed list
    ptList = new List<Point3d>();
    speedList = new List<Vector3d>();

    // Reset the agent simulation
    if(reset){
      //empty the agent list
      agentList = new List<Agent>();
      simulationCount = 0;

      //declare the agents and add to the agent list
      for(int i = 0; i < startPts.Count; i++){
        Agent agent01 = new Agent(startPts[i]);
        agentList.Add(agent01);
      }
    }

      //Run the agent simulation
    else{
      //setup boundary variable
      boxPt = bound.GetCorners()[0];
      xBound = bound.X.Length + boxPt.X;
      yBound = bound.Y.Length + boxPt.Y;
      zBound = bound.Z.Length + boxPt.Z;
      //Print("corner: " + bound.GetCorners()[0]);
      Print("center: " + bound.Center);
      Print("xbox: " + bound.X.Length);
      Print("ybox: " + bound.Y.Length);
      Print("zbox: " + bound.Z.Length);
      //Print("xBound: " + xBound);
      //Print("yBound: " + yBound);
      //Print("zBound: " + zBound);

      //for(int i = 0; i < agentList.Count; i++){
      System.Threading.Tasks.Parallel.For(0, agentList.Count, i => {
        {
          //Run agents
          Agent agent01 = agentList[i];
          agent01.run();

          lock(agentList){
            //Update the location list and speed list
            ptList.Add(agent01.loc);
            speedList.Add(agent01.speed);
          }
        }
        });
      //Add one value to the simulation count
      simulationCount++;
    }

    A = ptList;
    B = speedList;
    C = simulationCount;
# ---------- c_script_6: C# additional code ----------
  //Global Variable List
  static List<Agent> agentList = new List<Agent>();
  static List<Point3d> ptList = new List<Point3d>();
  static List<Vector3d> speedList = new List<Vector3d>();

  static int simulationCount;

  static double separationMag;
  static double separationFOV;

  static double cohesionMag;
  static double cohesionFOV;

  static double alignmentMag;
  static double alignmentFOV;

  static double attractMag;
  
  static double maxSpeed;

  static Box bound;

  //boundary variables
  static double xBound;
  static double yBound;
  static double zBound;
  static Point3d boxPt;

  //Agent
  public class Agent{
    //Class variables
    public Point3d loc = new Point3d();
    public Vector3d speed = new Vector3d();

    Vector3d accel = new Vector3d();
    //double maxSpeed = 1.00;

    //Class constructor
    public Agent(Point3d _loc){
      loc = _loc;
    }

    public void run(){
      //boundaryCross();
      move();
      separation();
      cohesion();
      alignment();
      attract();
      //boundaryCross();
    }

    //move each agent based on a speed vector
    void move(){
      //speed = new Vector3d(0, 0, 0);
      speed += accel;
      if(speed.Length > maxSpeed){
        speed.Unitize();
        speed *= maxSpeed;
      }
      loc += speed;

      accel = new Vector3d(0, 0, 0);

    }

    void attract(){
      Vector3d dir = new Vector3d();
      Vector3d v1 = bound.Center - loc;
      v1.Unitize();
      dir += v1;
      dir *= attractMag;

      accel += dir;

    }

    //Boundary Cross
    void boundaryCross(){
      if (loc.X < boxPt.X){
        //loc.X = xBound;
        loc.X = bound.Center.X;
      }else if (loc.X > xBound){
        //loc.X = boxPt.X;
        loc.X = bound.Center.X;
      }

      if (loc.Y < boxPt.Y){
        //loc.Y = yBound;
        loc.Y = bound.Center.Y;
      }else if (loc.Y > yBound){
        //loc.Y = boxPt.Y;
        loc.Y = bound.Center.Y;
      }

      if (loc.Z < boxPt.Z){
        //loc.Z = zBound;
        loc.Z = bound.Center.Z;
      }else if (loc.Z > zBound){
        //loc.Z = boxPt.Z;
        loc.Z = bound.Center.Z;
      }
    }


    //Separation Behaviour functions
    void separation(){
      //Declare an empty direction variable and a counter
      Vector3d dir = new Vector3d();
      int count = 0;

      for(int i = 0; i < agentList.Count; i++){
        //find the distance from current agent to all other agents
        Agent otherAgent = agentList[i];
        double dist = loc.DistanceTo(otherAgent.loc);

        //find nearby agents within the FOV
        if(dist > 0 && dist < separationFOV){
          //create a vector that moves away from other agents
          Vector3d v1 = loc - otherAgent.loc;


          //scale the vector's magnitude so when its closer it becomes more powerful
          v1.Unitize();
          v1 *= 1 / dist;

          //add the vector to the separation direction & specify that 1 agent is in the FOV with count
          dir += v1;
          count++;
        }
      }

      //if any agents are in FOV, add them to the acce
      if (count > 0){
        //divide the direction vector by count for average
        dir /= count;

        //scale vector
        dir *= 100;
        dir *= separationMag;

        //add to the acc
        accel += dir;
      }
    }


    //Cohesion Behavior function
    void cohesion(){
      Vector3d dir = new Vector3d();
      int count = 0;

      for (int i = 0; i < agentList.Count; i++){
        //find the distance from current agent to all other agents
        Agent otherAgent = agentList[i];
        double dist = loc.DistanceTo(otherAgent.loc);
        //find nearby agents within the FOV
        if(dist > 0 && dist < cohesionFOV){
          //find all other agent locs & add to dir
          dir += (Vector3d) otherAgent.loc;
          count++;
        }
      }

      if(count > 0){
        //find the average loc of other agents in FOV
        dir /= count;

        //move towards the average
        dir -= (Vector3d) loc;

        //scale & add to acc
        dir *= cohesionMag;
        accel += dir;
      }

    }

    //Alignment Behaviour function
    void alignment(){
      Vector3d dir = new Vector3d();
      int count = 0;

      for (int i = 0; i < agentList.Count; i++){
        //find the distance from current agent to all other agents
        Agent otherAgent = agentList[i];
        double dist = loc.DistanceTo(otherAgent.loc);
        //find nearby agents within the FOV
        if(dist > 0 && dist < alignmentFOV){
          //find speed vector of other agents
          dir += otherAgent.speed;
          count++;
        }
      }
      if(count > 0){
        //find the average speed of neighbors
        dir /= count;

        //scale & add to acc
        dir *= alignmentMag;
        accel += dir;
      }
    }




  }
# ---------- end c_script_6 ----------
ln = Line(StartPoint=c_script_6.A, EndPoint=c_script_6.B)
# Before Starting
# 
# enable timer
# press button
timer_2 = Timer(TimerInterval=20, Target=c_script_6)  # disabled
panel_19 = Panel(c_script_6.C)
panel_20 = Panel(c_script_6.out)
pgroups = PointGroups(Points=c_script_6.A, Distance=Slider(20, range=0..100))  # -> Groups, Indices
number_slider_2 = Slider(4.9, range=0..10)
inter = InterconnectPoints(Pts=pgroups.Groups)  # disabled
cir = Circle(Plane=c_script_6.A, Radius=number_slider_2)
rgb = ColourRGB(Alpha=255, Red=Slider(255, range=0..255), Green=Slider(210.2, range=0..255), Blue=Slider(98.2, range=0..255))
preview = CustomPreview(Geometry=inter, Material=rgb)
sync_object_2 = SyncObject(
    GM=inter,
    AlwaysIncludeTextureCoordinates=False,
    Clickable=False,
    DefaultCurveThicknessMillimeters=2.5,
    DefaultGlossPercent=0,
    DefaultMaterialColor=RGB(255, 230, 87),
    DefaultSpecularPercent=0,
    Grabbable=False,
    Interactive=False,
    Occlusion=False,
    Outline=False,
    hasSerializedData=True)
sync = SyncObject(
    GM=cir,
    AlwaysIncludeTextureCoordinates=False,
    Clickable=False,
    DefaultCurveThicknessMillimeters=2.5,
    DefaultGlossPercent=0,
    DefaultMaterialColor=RGB(255, 225, 100),
    DefaultSpecularPercent=0,
    Grabbable=False,
    Interactive=False,
    Occlusion=False,
    Outline=False,
    hasSerializedData=True)
cloud = CloudDisplay(Points=c_script_6.A, Colours=rgb, Size=number_slider_2, SpriteType=0)
